# Grasshopper definition Introduction.gh (Grasshopper 1.0.7)
# plug-ins: StudFinderGH

member_types = MemberTypes({"Generic 400S200-54": "556d077e-7e18-4884-9bca-5517d916b591", "KHSS 362S175-43": "ede1eb89-7619-463f-b98c-e7d73e6aa9c0", "KHSS 362S175-33": "5bd775f1-206a-44f0-af89-b5b2b27cdc89", "KHSS 362T216-43": "ea87577b-3fd8-49b5-803c-985e0c5110af", "KHSS 362T216-33": "49c342aa-afab-4995-8dae-c67662ec8984", "KHSS 400S200-54": "60e79546-f4d2-47df-a04e-cfba5eaba21f", "KHSS 400S200-43": "4f04a8e0-27ee-44a6-8a7d-b7a879748100", "KHSS 400T250-54": "def8422c-9b0e-42f2-8bea-50400eb86bc0", "KHSS 400T250-43": "6fd3c178-4b77-4698-a19a-3ed15b468a95", "KHSS 600S175-54": "29823e7b-58b1-45be-85cd-cff0c9c9c73d"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}, selected="KHSS 362S175-43")
crv_optionalopenings = Curve(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)
# Wall With Self Created Recipe
# Create a region using a recipe that is created using grasshopper components rather than from a users asset library.
crv = Curve(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)
# Weak Axis Truss
member_types_2 = MemberTypes({"Generic 400S200-54": "556d077e-7e18-4884-9bca-5517d916b591", "KHSS 362S175-43": "ede1eb89-7619-463f-b98c-e7d73e6aa9c0", "KHSS 362S175-33": "5bd775f1-206a-44f0-af89-b5b2b27cdc89", "KHSS 362T216-43": "ea87577b-3fd8-49b5-803c-985e0c5110af", "KHSS 362T216-33": "49c342aa-afab-4995-8dae-c67662ec8984", "KHSS 400S200-54": "60e79546-f4d2-47df-a04e-cfba5eaba21f", "KHSS 400S200-43": "4f04a8e0-27ee-44a6-8a7d-b7a879748100", "KHSS 400T250-54": "def8422c-9b0e-42f2-8bea-50400eb86bc0", "KHSS 400T250-43": "6fd3c178-4b77-4698-a19a-3ed15b468a95", "KHSS 600S175-54": "29823e7b-58b1-45be-85cd-cff0c9c9c73d"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}, selected="KHSS 362T216-43")
# The simplest possible way to create a wall panel and export
# Simplest possible wall panel
crv_2 = Curve(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)
# Recipes with Region
recipes = Recipes({"Wall 362 16\" oc": "2a88eecf-718d-4362-87a4-e49761dfd3d3", "Wall 362 24\" oc": "e9516b61-ff96-4574-81ac-af9894d97a88", "Wall 400 16\" oc": "0aea68b1-20a9-45ea-8ffd-e98a2d4a0f2f", "Wall 400 16\" oc | Box Header": "a2f260fb-6329-474b-801a-1c2732aa5c70", "Wall 400 16\" oc | Truss Header": "398b128d-a3d6-479d-ab37-7c326e84cdb0", "Wall 400 16\" oc, 8' Max Panels": "04e42ebf-d304-4fd7-a6c4-1af94a09cdc4", "Wall 400 24\" oc": "8e35917f-5a8e-451f-8313-03fb694b8c81", "Wall 600 16\" oc": "60e5772b-8519-441c-8657-c556af2f16dc", "Wall 600 24\" oc": "defa7591-0cef-4d57-8bee-f1aac088e1f9"}, selected="Wall 400 16\" oc | Box Header")
truss = TrussFillStrategy(
    MaxBayWidth=Slider(15, range=0..24),
    BayGap=3,
    IncludeVerticals=Toggle(True),
    BayPattern=0,
    TrussMemberType=member_types,
    VertexTolerance=6)
# Set wall framing by using a predefined Recipe asset.
crv_optionalopenings_2 = Curve(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)
# REGIONS / RECIPES
region = CreateRegion(Boundary=crv_2, Name="R")
wall = WallFillStrategy(Spacing=Slider(14, range=0..24), Origin=null, MemberType=member_types)
crv_3 = Curve(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)
trussheader = TrussHeader(Height=12, TrussStrategy=truss)
boxheader = BoxHeader(StudMemberType=member_types, TrackMemberType=member_types)
truss_2 = TrussFillStrategy(
    MaxBayWidth=Slider(48, range=0..60),
    BayGap=3,
    IncludeVerticals=Toggle(True),
    BayPattern=Slider(0, range=0..3),
    TrussMemberType=member_types_2,
    VertexTolerance=6)
# Create a weak axis truss using a truss fill strategy.  This fill strategy is not 100% fabrication ready as of right now but it is very close and is in refinement stage of development.
loadsim = SimilarityToLoadDirection(Threshold=0.5, VerticalMemberType=member_types_2, HorizontalMemberType=member_types_2)
region_2 = CreateRegion(Boundary=crv_3, Openings=crv_optionalopenings_2, Recipe=recipes, Name="R")
merge = Merge(Data1=loadsim, Data2=truss_2)
strategy_optionalheader = RegionStrategy(trussheader)
recipe = CreateRecipe(Strategies=wall)
recipe_2 = CreateRecipe(Strategies=merge)
crv_4 = Curve(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)
jams = CreateJamDivide(Recipe=recipe, Threshold=0.5, HeaderStrategy=strategy_optionalheader)
namemembers = StandardNaming()
loadsim_2 = SimilarityToLoadDirection(Threshold=0.5, VerticalMemberType=member_types, HorizontalMemberType=member_types)
region_3 = CreateRegion(Boundary=crv_4, Recipe=recipe_2, Name="R")
merge_2 = Merge(Data1=jams, Data2=loadsim_2, Data3=namemembers)
recipe_3 = CreateRecipe(Strategies=merge_2)
region_4 = CreateRegion(Boundary=crv, Openings=crv_optionalopenings, Recipe=recipe_3, Name="R")
path = FilePath()
# Export
export = ExportAssemblies(Path=path, Assembly=region, Export=Toggle(False))  # -> ExportableData, ExportSchedule
decsv = DeconstructCSV(CSV=export.ExportableData)  # -> Name, Header, Rows
panel = Panel(decsv.Rows)
# Vector Normal Guide
member_types_3 = MemberTypes({"Generic 400S200-54": "556d077e-7e18-4884-9bca-5517d916b591", "KHSS 362S175-43": "ede1eb89-7619-463f-b98c-e7d73e6aa9c0", "KHSS 362S175-33": "5bd775f1-206a-44f0-af89-b5b2b27cdc89", "KHSS 362T216-43": "ea87577b-3fd8-49b5-803c-985e0c5110af", "KHSS 362T216-33": "49c342aa-afab-4995-8dae-c67662ec8984", "KHSS 400S200-54": "60e79546-f4d2-47df-a04e-cfba5eaba21f", "KHSS 400S200-43": "4f04a8e0-27ee-44a6-8a7d-b7a879748100", "KHSS 400T250-54": "def8422c-9b0e-42f2-8bea-50400eb86bc0", "KHSS 400T250-43": "6fd3c178-4b77-4698-a19a-3ed15b468a95", "KHSS 600S175-54": "29823e7b-58b1-45be-85cd-cff0c9c9c73d"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}, selected="KHSS 362S175-33")
# GENERIC STRUCTURES
# Dimple Connection
member_types_4 = MemberTypes({"Generic 400S200-54": "556d077e-7e18-4884-9bca-5517d916b591", "KHSS 362S175-43": "ede1eb89-7619-463f-b98c-e7d73e6aa9c0", "KHSS 362S175-33": "5bd775f1-206a-44f0-af89-b5b2b27cdc89", "KHSS 362T216-43": "ea87577b-3fd8-49b5-803c-985e0c5110af", "KHSS 362T216-33": "49c342aa-afab-4995-8dae-c67662ec8984", "KHSS 400S200-54": "60e79546-f4d2-47df-a04e-cfba5eaba21f", "KHSS 400S200-43": "4f04a8e0-27ee-44a6-8a7d-b7a879748100", "KHSS 400T250-54": "def8422c-9b0e-42f2-8bea-50400eb86bc0", "KHSS 400T250-43": "6fd3c178-4b77-4698-a19a-3ed15b468a95", "KHSS 600S175-54": "29823e7b-58b1-45be-85cd-cff0c9c9c73d"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}, selected="KHSS 362S175-33")
member_types_5 = MemberTypes({"Generic 400S200-54": "556d077e-7e18-4884-9bca-5517d916b591", "KHSS 362S175-43": "ede1eb89-7619-463f-b98c-e7d73e6aa9c0", "KHSS 362S175-33": "5bd775f1-206a-44f0-af89-b5b2b27cdc89", "KHSS 362T216-43": "ea87577b-3fd8-49b5-803c-985e0c5110af", "KHSS 362T216-33": "49c342aa-afab-4995-8dae-c67662ec8984", "KHSS 400S200-54": "60e79546-f4d2-47df-a04e-cfba5eaba21f", "KHSS 400S200-43": "4f04a8e0-27ee-44a6-8a7d-b7a879748100", "KHSS 400T250-54": "def8422c-9b0e-42f2-8bea-50400eb86bc0", "KHSS 400T250-43": "6fd3c178-4b77-4698-a19a-3ed15b468a95", "KHSS 600S175-54": "29823e7b-58b1-45be-85cd-cff0c9c9c73d"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}, selected="KHSS 362S175-33")
# Handshake Connection
member_types_6 = MemberTypes({"Generic 400S200-54": "556d077e-7e18-4884-9bca-5517d916b591", "KHSS 362S175-43": "ede1eb89-7619-463f-b98c-e7d73e6aa9c0", "KHSS 362S175-33": "5bd775f1-206a-44f0-af89-b5b2b27cdc89", "KHSS 362T216-43": "ea87577b-3fd8-49b5-803c-985e0c5110af", "KHSS 362T216-33": "49c342aa-afab-4995-8dae-c67662ec8984", "KHSS 400S200-54": "60e79546-f4d2-47df-a04e-cfba5eaba21f", "KHSS 400S200-43": "4f04a8e0-27ee-44a6-8a7d-b7a879748100", "KHSS 400T250-54": "def8422c-9b0e-42f2-8bea-50400eb86bc0", "KHSS 400T250-43": "6fd3c178-4b77-4698-a19a-3ed15b468a95", "KHSS 600S175-54": "29823e7b-58b1-45be-85cd-cff0c9c9c73d"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}, selected="KHSS 362S175-33")
# Complex Structure
Z = UnitZ(Factor=1)
connection_types = ConnectionTypes({"Stud Dimple Connection": "2581731e-58da-4c77-8935-8fd2473f4eea", "Stud Dimple (Sloppy)": "97297fbf-3f6c-4598-8d00-57c771488e64", "Stud Handshake Connection": "f55e9af3-dd87-4f58-bea4-11cbdfaba10b", "Stud Copable Handshake": "28199d8a-6f95-48c0-bf3b-d206664cd57a", "Stud Flange to Web Connection": "9bd6b3c9-839b-4600-bba6-c8ec132b99ff", "Stud Parallel Strongback Connection": "462d45a9-2dc7-484d-ac61-3db88dbc2aa7", "Stud Flange to Flange Connection": "ebff9ad3-4e19-4e53-9aab-f2a6b3a4be09", "Stud Slotted Track Connection": "a975710c-f35d-4f71-ac29-f77ada96126b", "Rib - Stud Web Connection": "4cb0c20f-06d5-4907-8e42-da93d5ef216a", "Rib - Stud Flange Connection": "d6eaef59-66f2-4c19-a9c5-b24c5579aa15", "Rib Slot Connection": "b9677c3b-e555-419f-ac2c-2ca0755ef883", "Simple HSS Connection": "07a45022-a3e4-4477-8a23-1ed4e580f013", "Stud Extendable Connection": "56bd2050-fdc7-4a68-ab7c-448841783ef1", "Stud Handshake Connection-clone": "4610f687-20f2-433b-861f-62937d83a78d"}, selected="Stud Dimple Connection")
connection_types_2 = ConnectionTypes({"Stud Dimple Connection": "2581731e-58da-4c77-8935-8fd2473f4eea", "Stud Dimple (Sloppy)": "97297fbf-3f6c-4598-8d00-57c771488e64", "Stud Handshake Connection": "f55e9af3-dd87-4f58-bea4-11cbdfaba10b", "Stud Copable Handshake": "28199d8a-6f95-48c0-bf3b-d206664cd57a", "Stud Flange to Web Connection": "9bd6b3c9-839b-4600-bba6-c8ec132b99ff", "Stud Parallel Strongback Connection": "462d45a9-2dc7-484d-ac61-3db88dbc2aa7", "Stud Flange to Flange Connection": "ebff9ad3-4e19-4e53-9aab-f2a6b3a4be09", "Stud Slotted Track Connection": "a975710c-f35d-4f71-ac29-f77ada96126b", "Rib - Stud Web Connection": "4cb0c20f-06d5-4907-8e42-da93d5ef216a", "Rib - Stud Flange Connection": "d6eaef59-66f2-4c19-a9c5-b24c5579aa15", "Rib Slot Connection": "b9677c3b-e555-419f-ac2c-2ca0755ef883", "Simple HSS Connection": "07a45022-a3e4-4477-8a23-1ed4e580f013", "Stud Extendable Connection": "56bd2050-fdc7-4a68-ab7c-448841783ef1", "Stud Handshake Connection-clone": "4610f687-20f2-433b-861f-62937d83a78d"}, selected="Stud Dimple Connection")
connection_types_3 = ConnectionTypes({"Stud Dimple Connection": "2581731e-58da-4c77-8935-8fd2473f4eea", "Stud Dimple (Sloppy)": "97297fbf-3f6c-4598-8d00-57c771488e64", "Stud Handshake Connection": "f55e9af3-dd87-4f58-bea4-11cbdfaba10b", "Stud Copable Handshake": "28199d8a-6f95-48c0-bf3b-d206664cd57a", "Stud Flange to Web Connection": "9bd6b3c9-839b-4600-bba6-c8ec132b99ff", "Stud Parallel Strongback Connection": "462d45a9-2dc7-484d-ac61-3db88dbc2aa7", "Stud Flange to Flange Connection": "ebff9ad3-4e19-4e53-9aab-f2a6b3a4be09", "Stud Slotted Track Connection": "a975710c-f35d-4f71-ac29-f77ada96126b", "Rib - Stud Web Connection": "4cb0c20f-06d5-4907-8e42-da93d5ef216a", "Rib - Stud Flange Connection": "d6eaef59-66f2-4c19-a9c5-b24c5579aa15", "Rib Slot Connection": "b9677c3b-e555-419f-ac2c-2ca0755ef883", "Simple HSS Connection": "07a45022-a3e4-4477-8a23-1ed4e580f013", "Stud Extendable Connection": "56bd2050-fdc7-4a68-ab7c-448841783ef1", "Stud Handshake Connection-clone": "4610f687-20f2-433b-861f-62937d83a78d"}, selected="Stud Handshake Connection")
# In this structure we allow both dimple and handshake connections.  If we only allow dimple connections or handshake connections this structure will fail to solve appropriately
crv_5 = Curve([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])
connection_types_4 = ConnectionTypes({"Stud Dimple Connection": "2581731e-58da-4c77-8935-8fd2473f4eea", "Stud Dimple (Sloppy)": "97297fbf-3f6c-4598-8d00-57c771488e64", "Stud Handshake Connection": "f55e9af3-dd87-4f58-bea4-11cbdfaba10b", "Stud Copable Handshake": "28199d8a-6f95-48c0-bf3b-d206664cd57a", "Stud Flange to Web Connection": "9bd6b3c9-839b-4600-bba6-c8ec132b99ff", "Stud Parallel Strongback Connection": "462d45a9-2dc7-484d-ac61-3db88dbc2aa7", "Stud Flange to Flange Connection": "ebff9ad3-4e19-4e53-9aab-f2a6b3a4be09", "Stud Slotted Track Connection": "a975710c-f35d-4f71-ac29-f77ada96126b", "Rib - Stud Web Connection": "4cb0c20f-06d5-4907-8e42-da93d5ef216a", "Rib - Stud Flange Connection": "d6eaef59-66f2-4c19-a9c5-b24c5579aa15", "Rib Slot Connection": "b9677c3b-e555-419f-ac2c-2ca0755ef883", "Simple HSS Connection": "07a45022-a3e4-4477-8a23-1ed4e580f013", "Stud Extendable Connection": "56bd2050-fdc7-4a68-ab7c-448841783ef1", "Stud Handshake Connection-clone": "4610f687-20f2-433b-861f-62937d83a78d"}, selected="Stud Handshake Connection")
X = UnitX(Factor=1)
Z_2 = UnitZ(Factor=1)
# In this structure we allow both dimple and handshake connections.  Changing the vector normal guide in the create member component helps the solver determine which connection type to use.
crv_6 = Curve([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])
# Using lines to create a member and solve a structure.  Handshake connections only
crv_7 = Curve([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])
# Using lines to create a member and solve a structure.  Dimple connections only
crv_8 = Curve([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])
xprod = CrossProduct(VectorA=crv_5, VectorB=Z, Unitize=False)  # -> Vector, Length
connection_types_5 = ConnectionTypes({"Stud Dimple Connection": "2581731e-58da-4c77-8935-8fd2473f4eea", "Stud Dimple (Sloppy)": "97297fbf-3f6c-4598-8d00-57c771488e64", "Stud Handshake Connection": "f55e9af3-dd87-4f58-bea4-11cbdfaba10b", "Stud Copable Handshake": "28199d8a-6f95-48c0-bf3b-d206664cd57a", "Stud Flange to Web Connection": "9bd6b3c9-839b-4600-bba6-c8ec132b99ff", "Stud Parallel Strongback Connection": "462d45a9-2dc7-484d-ac61-3db88dbc2aa7", "Stud Flange to Flange Connection": "ebff9ad3-4e19-4e53-9aab-f2a6b3a4be09", "Stud Slotted Track Connection": "a975710c-f35d-4f71-ac29-f77ada96126b", "Rib - Stud Web Connection": "4cb0c20f-06d5-4907-8e42-da93d5ef216a", "Rib - Stud Flange Connection": "d6eaef59-66f2-4c19-a9c5-b24c5579aa15", "Rib Slot Connection": "b9677c3b-e555-419f-ac2c-2ca0755ef883", "Simple HSS Connection": "07a45022-a3e4-4477-8a23-1ed4e580f013", "Stud Extendable Connection": "56bd2050-fdc7-4a68-ab7c-448841783ef1", "Stud Handshake Connection-clone": "4610f687-20f2-433b-861f-62937d83a78d"}, selected="Stud Handshake Connection")
connection_types_6 = ConnectionTypes({"Stud Dimple Connection": "2581731e-58da-4c77-8935-8fd2473f4eea", "Stud Dimple (Sloppy)": "97297fbf-3f6c-4598-8d00-57c771488e64", "Stud Handshake Connection": "f55e9af3-dd87-4f58-bea4-11cbdfaba10b", "Stud Copable Handshake": "28199d8a-6f95-48c0-bf3b-d206664cd57a", "Stud Flange to Web Connection": "9bd6b3c9-839b-4600-bba6-c8ec132b99ff", "Stud Parallel Strongback Connection": "462d45a9-2dc7-484d-ac61-3db88dbc2aa7", "Stud Flange to Flange Connection": "ebff9ad3-4e19-4e53-9aab-f2a6b3a4be09", "Stud Slotted Track Connection": "a975710c-f35d-4f71-ac29-f77ada96126b", "Rib - Stud Web Connection": "4cb0c20f-06d5-4907-8e42-da93d5ef216a", "Rib - Stud Flange Connection": "d6eaef59-66f2-4c19-a9c5-b24c5579aa15", "Rib Slot Connection": "b9677c3b-e555-419f-ac2c-2ca0755ef883", "Simple HSS Connection": "07a45022-a3e4-4477-8a23-1ed4e580f013", "Stud Extendable Connection": "56bd2050-fdc7-4a68-ab7c-448841783ef1", "Stud Handshake Connection-clone": "4610f687-20f2-433b-861f-62937d83a78d"}, selected="Stud Dimple Connection")
member = CreateMember(Axis=crv_7, MemberType=member_types_6)
member_2 = CreateMember(Axis=crv_6, NormalVector=X, MemberType=member_types_3)
member_3 = CreateMember(Axis=crv_8, MemberType=member_types_4)
member_4 = CreateMember(Axis=crv_5, NormalVector=xprod.Vector, MemberType=member_types_5)
merge_3 = Merge(Data1=connection_types, Data2=connection_types_4)
merge_4 = Merge(Data1=connection_types_2, Data2=connection_types_3)
structure = CreateStructure(Members=member, ConnectionTypes=connection_types_5)
structure_2 = CreateStructure(Members=member_2, ConnectionTypes=merge_3)
structure_3 = CreateStructure(Members=member_3, ConnectionTypes=connection_types_6)
structure_4 = CreateStructure(Members=member_4, ConnectionTypes=merge_4)
